# Grasshopper definition Works.gh (Grasshopper 0.9.14)

x = Slider(0.19, range=0..50)
y = Slider(8.78, range=0..50)
z = Slider(0.05, range=-5..50)

p_0 = PointXYZ(
    XComponent=Slider(5.2, range=-12..25),
    YComponent=Slider(0.273, range=-12..12),
    ZComponent=Slider(2.527, range=-12..12),
    System=PlaneXY(0, 0, 0))
p_1 = PointXYZ(
    XComponent=Slider(2.6, range=-12..12),
    YComponent=Slider(0.273, range=-12..12),
    ZComponent=Slider(3.625, range=-12..12),
    System=PlaneXY(0, 0, 0))
p_2 = PointXYZ(
    XComponent=Slider(1.7, range=-20..20),
    YComponent=Slider(0.273, range=-12..12),
    ZComponent=Slider(0.569, range=-12..12),
    System=PlaneXY(0, 0, 0))
p_3 = PointXYZ(
    XComponent=Slider(4.39, range=-20..20),
    YComponent=Slider(0.273, range=-12..12),
    ZComponent=Slider(0.075, range=-12..12),
    System=PlaneXY(0, 0, 0))
p_4 = PointXYZ(
    XComponent=Slider(6.633, range=-12..12),
    YComponent=Slider(0.273, range=-12..12),
    ZComponent=Slider(-0.257, range=-12..12),
    System=PlaneXY(0, 0, 0))
p_7 = PointXYZ(
    XComponent=Slider(12.4, range=-20..20),
    YComponent=Slider(0.273, range=-12..12),
    ZComponent=Slider(0, range=-12..12),
    System=PlaneXY(0, 0, 0))
p_5 = PointXYZ(
    XComponent=Slider(8.425, range=-12..12),
    YComponent=Slider(0.273, range=-12..12),
    ZComponent=Slider(3.376, range=-12..12),
    System=PlaneXY(0, 0, 0))
p_6 = PointXYZ(
    XComponent=Slider(9.766, range=-20..20),
    YComponent=Slider(0.273, range=-12..12),
    ZComponent=Slider(-0.1, range=-12..12),
    System=PlaneXY(0, 0, 0))
crv = Curve(Vertices=[p_0, p_1, p_2, p_3, p_4, p_5, p_6, p_7], Degree=3, Periodic=False)  # -> Curve, Length, Domain

p_0_2 = PointXYZ(
    XComponent=Slider(4.8, range=-12..25),
    YComponent=Slider(12, range=-12..12),
    ZComponent=Slider(2.864, range=-12..12),
    System=PlaneXY(0, 0, 0))
p_1_2 = PointXYZ(
    XComponent=Slider(2.2, range=-12..12),
    YComponent=Slider(12, range=-12..12),
    ZComponent=Slider(4.187, range=-12..12),
    System=PlaneXY(0, 0, 0))
p_2_2 = PointXYZ(
    XComponent=Slider(1.33, range=-20..20),
    YComponent=Slider(12, range=-12..12),
    ZComponent=Slider(0.569, range=-12..12),
    System=PlaneXY(0, 0, 0))
p_3_2 = PointXYZ(
    XComponent=Slider(3.918, range=-20..20),
    YComponent=Slider(12, range=-12..12),
    ZComponent=Slider(0.327, range=-12..12),
    System=PlaneXY(0, 0, 0))
p_4_2 = PointXYZ(
    XComponent=Slider(5.245, range=-12..12),
    YComponent=Slider(12, range=-12..12),
    ZComponent=Slider(0.117, range=-12..12),
    System=PlaneXY(0, 0, 0))
p_7_2 = PointXYZ(
    XComponent=Slider(12.2, range=-20..20),
    YComponent=Slider(12, range=-12..12),
    ZComponent=Slider(0.31, range=-12..12),
    System=PlaneXY(0, 0, 0))
p_5_2 = PointXYZ(
    XComponent=Slider(7.049, range=-12..12),
    YComponent=Slider(12, range=-12..12),
    ZComponent=Slider(2.885, range=-12..12),
    System=PlaneXY(0, 0, 0))
p_6_2 = PointXYZ(
    XComponent=Slider(8.7, range=-20..20),
    YComponent=Slider(12, range=-12..12),
    ZComponent=Slider(0, range=-12..12),
    System=PlaneXY(0, 0, 0))
crv_2 = Curve(Vertices=[p_0_2, p_1_2, p_2_2, p_3_2, p_4_2, p_5_2, p_6_2, p_7_2], Degree=3, Periodic=False)  # -> Curve, Length, Domain

pt = PointXYZ(XComponent=x, YComponent=y, ZComponent=z, System=PlaneXY(0, 0, 0))

x_2 = Slider(1.77, range=0..50)
y_2 = Slider(8.78, range=0..50)
x_3 = Slider(0.29, range=0..50)
z_2 = Slider(1.4, range=0..50)
x_4 = Slider(1.94, range=0..50)
y_3 = Slider(8.78, range=0..50)
y_4 = Slider(8.78, range=0..50)
z_3 = Slider(1.44, range=-5..50)
z_4 = Slider(1.78, range=0..50)
x_5 = Slider(1.36, range=-5..50)
x_6 = Slider(9.9, range=0..50)
y_5 = Slider(8.78, range=0..50)
z_5 = Slider(2, range=0..50)
x_7 = Slider(9.14, range=0..50)
y_6 = Slider(8.78, range=0..50)
z_6 = Slider(0, range=-5..50)
y_7 = Slider(8.78, range=0..50)
x_8 = Slider(9.9, range=0..50)
x_9 = Slider(5.25, range=0..50)
z_7 = Slider(2.7, range=-5..50)
y_8 = Slider(8.78, range=0..50)
y_9 = Slider(8.78, range=0..50)
z_8 = Slider(0, range=-5..50)
z_9 = Slider(-0.22, range=-5..50)
pt_2 = PointXYZ(XComponent=x_2, YComponent=y_2, ZComponent=z_2, System=PlaneXY(0, 0, 0))
pt_3 = PointXYZ(XComponent=x_3, YComponent=y_3, ZComponent=z_3, System=PlaneXY(0, 0, 0))
pt_4 = PointXYZ(XComponent=x_4, YComponent=y_4, ZComponent=z_4, System=PlaneXY(0, 0, 0))
pt_5 = PointXYZ(XComponent=x_6, YComponent=y_6, ZComponent=z_6, System=PlaneXY(0, 0, 0))
pt_6 = PointXYZ(XComponent=x_5, YComponent=y_5, ZComponent=z_5, System=PlaneXY(0, 0, 0))
pt_7 = PointXYZ(XComponent=x_7, YComponent=y_7, ZComponent=z_7, System=PlaneXY(0, 0, 0))
pt_8 = PointXYZ(XComponent=x_8, YComponent=y_8, ZComponent=z_8, System=PlaneXY(0, 0, 0))
pt_9 = PointXYZ(XComponent=x_9, YComponent=y_9, ZComponent=z_9, System=PlaneXY(0, 0, 0))

crv_3 = Curve(Vertices=[pt_2, pt_4, pt_6, pt_3, pt, pt_9, pt_7, pt_5, pt_8], Degree=3, Periodic=False)  # -> Curve, Length, Domain

base_geometry = Curve(reparameterize(crv.Curve))
rail_curve = Curve(reparameterize(<curve referenced from the Rhino model>))
pt_on_curve = Point(<point referenced from the Rhino model>)
len = Length(Curve=rail_curve)
division = Division(A=len, B=Slider(0.95, range=0..2))
int = Integer(division)
division_2 = Division(A=len, B=int)
panel = Panel(int)
divide = DivideCurve(Curve=rail_curve, Count=int, Kinks=False)  # -> Points, Tangents, Parameters
vec2pt = Vector2Pt(PointA=pt_on_curve, PointB=divide.Points, Unitize=False)  # -> Vector, Length
panel_2 = Panel(division_2)
move = Move(Geometry=base_geometry, Motion=vec2pt.Vector)  # -> Geometry, Transform

base_geometry_2 = Curve(reparameterize(crv_2.Curve))
rail_curve_2 = Curve(reparameterize(<curve referenced from the Rhino model>))
pt_on_curve_2 = Point(<point referenced from the Rhino model>)
len_2 = Length(Curve=rail_curve_2)
division_3 = Division(A=len_2, B=Slider(0.95, range=0..2))
int_2 = Integer(division_3)
division_4 = Division(A=len_2, B=int_2)
panel_3 = Panel(int_2)
divide_2 = DivideCurve(Curve=rail_curve_2, Count=int_2, Kinks=False)  # -> Points, Tangents, Parameters
vec2pt_2 = Vector2Pt(PointA=pt_on_curve_2, PointB=divide_2.Points, Unitize=False)  # -> Vector, Length
move_2 = Move(Geometry=base_geometry_2, Motion=vec2pt_2.Vector)  # -> Geometry, Transform
panel_4 = Panel(division_4)

xy = XYPlane(Origin=Point(0, 0, 0))
xy_2 = XYPlane(Origin=Point(0, 0, 0))
xy_3 = XYPlane(Origin=Point(0, 0, 0))
xy_4 = XYPlane(Origin=Point(0, 0, 0))
panel_5 = Panel("""0
4
6
9""")
panel_6 = Panel("""0
1
2
3""")
panel_7 = Panel("""0
1
2
3""")
panel_8 = Panel("""0
4
6
9""")
pt_10 = Point(<point referenced from the Rhino model>)
crv_4 = Curve([<curve referenced from the Rhino model> x2])
pt_11 = Point(<point referenced from the Rhino model>)

panel_9 = Panel("""6
5
4
3""")
panel_10 = Panel("""5
6""")

cp = ControlPoints(Curve=move.Geometry)  # -> Points, Weights, Knots
attractor_point = Point(<point referenced from the Rhino model>)
altezza_bozzo = Slider(-0.4, range=-3..5)
item = ListItem(List=cp.Points, Index="5", Wrap=False)
# ATTRATTORI!
dist = Distance(PointA=attractor_point, PointB=item)
multiplication = Multiplication(A=dist, B=altezza_bozzo)
cir = Circle(Plane=attractor_point, Radius=1)
tag = TextTag3D(Location=cir, Text="1", Size=1)

ampiezza_arena = Slider(-3.75, range=-5..5)
attractor_point_2 = Point(<point referenced from the Rhino model>)
circle = CircleCNR(Center=attractor_point_2, Normal=attractor_point_2, Radius=1)
tag_2 = TextTag3D(Location=attractor_point_2, Text="2", Size=1)

cp_2 = ControlPoints(Curve=move_2.Geometry)  # -> Points, Weights, Knots
attractor_point_3 = Point(<point referenced from the Rhino model>)
altezza_bozzo_2 = Slider(0.57, range=-3..5)
item_2 = ListItem(List=cp_2.Points, Index="5", Wrap=False)
dist_2 = Distance(PointA=attractor_point_3, PointB=item_2)
multiplication_2 = Multiplication(A=dist_2, B=altezza_bozzo_2)
cir_2 = Circle(Plane=attractor_point_3, Radius=1)
tag_3 = TextTag3D(Location=cir_2, Text="1", Size=1)

attractor_point_2_2 = Point(<point referenced from the Rhino model>)
ampiezza_arena_2 = Slider(0.47, range=-0.8..1)
circle_2 = CircleCNR(Center=attractor_point_2_2, Normal=attractor_point_2_2, Radius=1)
tag_4 = TextTag3D(Location=attractor_point_2_2, Text="2", Size=1)

Z = UnitZ(Factor=multiplication)
Z_2 = UnitZ(Factor=multiplication_2)

move_3 = Move(Geometry=item, Motion=Z)  # -> Geometry, Transform
replace = ListReplace(List=cp.Points, Item=move_3.Geometry, Indices="5", Wrap=False)
crv_5 = Curve(Vertices=replace, Degree=3, Periodic=False)  # -> Curve, Length, Domain
preview = CustomPreview(Geometry=[cir, circle], Shader=ColourSwatch(SwatchColor=RGB(17, 0, 255)))

move_4 = Move(Geometry=item_2, Motion=Z_2)  # -> Geometry, Transform
replace_2 = ListReplace(List=cp_2.Points, Item=move_4.Geometry, Indices="5", Wrap=False)
crv_6 = Curve(Vertices=replace_2, Degree=3, Periodic=False)  # -> Curve, Length, Domain
preview_2 = CustomPreview(Geometry=[cir_2, circle_2], Shader=ColourSwatch(SwatchColor=RGB(17, 0, 255)))

cp_3 = ControlPoints(Curve=crv_5.Curve)  # -> Points, Weights, Knots
item_3 = ListItem(List=cp_3.Points, Index=panel_9, Wrap=False)

cp_4 = ControlPoints(Curve=crv_6.Curve)  # -> Points, Weights, Knots
item_4 = ListItem(List=cp_4.Points, Index=panel_10, Wrap=False)

item_5 = ListItem(List=cp_3.Points, Index="6", Wrap=False)
item_6 = ListItem(List=cp_4.Points, Index="7", Wrap=False)

dist_3 = Distance(PointA=attractor_point_2, PointB=item_5)

f_x = F1(Function="(x^-1)", X=dist_3)

dist_4 = Distance(PointA=attractor_point_2_2, PointB=item_6)
multiplication_3 = Multiplication(A=dist_4, B=ampiezza_arena_2)

multiplication_4 = Multiplication(A=f_x, B=ampiezza_arena)

f_x_2 = F1(Function="(x^-1)", X=dist_4)
X = UnitX(Factor=multiplication_4)
X_2 = UnitX(Factor=multiplication_3)

move_5 = Move(Geometry=item_3, Motion=X)  # -> Geometry, Transform
replace_3 = ListReplace(List=cp_3.Points, Item=move_5.Geometry, Indices=panel_9, Wrap=False)

move_6 = Move(Geometry=item_4, Motion=X_2)  # -> Geometry, Transform
replace_4 = ListReplace(List=cp_4.Points, Item=move_6.Geometry, Indices=panel_10, Wrap=False)

curve_base = Curve(Vertices=replace_3, Degree=3, Periodic=False)  # -> Curve, Length, Domain

spessore_costole = Slider(-0.25, range=-1..1)
xz = XZPlane(Origin=Point(0, 0, 0))
offset = Offset(Curve=curve_base.Curve, Distance=spessore_costole, Plane=xz, Corners=1)

curve_base_2 = Curve(Vertices=replace_4, Degree=3, Periodic=False)  # -> Curve, Length, Domain

spessore_costole_2 = Slider(-0.25, range=-1..1)
xz_2 = XZPlane(Origin=Point(0, 0, 0))
offset_2 = Offset(Curve=curve_base_2.Curve, Distance=spessore_costole_2, Plane=xz_2, Corners=1)

divlength = DivideLength(Curve=offset_2, Length=Slider(0.7, range=0..3))  # -> Points, Tangents, Parameters
Y = UnitY(Factor=1)
line = LineSDL(Start=divlength.Points, Direction=Y, Length=1)

divlength_2 = DivideLength(Curve=offset, Length=Slider(0.8, range=0..3))  # -> Points, Tangents, Parameters
Y_2 = UnitY(Factor=1)
line_2 = LineSDL(Start=divlength_2.Points, Direction=Y_2, Length=division_2)

weave = Weave(Pattern=[0, 1], Stream0=curve_base_2.Curve, Stream1=offset_2, NullGaps=False)
costole_1 = Loft(Curves=weave, Options={Adjust=False, Closed=False, Rebuild=10, Refit=0.01, LoftType=0, LoftEnds=0, LoftSimp=0})  # -> flatten(Loft)

weave_2 = Weave(Pattern=[0, 1], Stream0=curve_base.Curve, Stream1=offset, NullGaps=False)
costole_1_2 = Loft(Curves=weave_2, Options={Adjust=False, Closed=False, Rebuild=10, Refit=0.01, LoftType=0, LoftEnds=0, LoftSimp=0})  # -> flatten(Loft)

xprod = CrossProduct(VectorA=line, VectorB=divlength.Tangents, Unitize=False)  # -> Vector, Length
unit = UnitVector(Vector=xprod.Vector)
multiplication_5 = Multiplication(A=unit, B=Slider(0.16, range=-0.5..0.5))
extr = Extrude(Base=line, Direction=multiplication_5)
xprod_2 = CrossProduct(VectorA=line, VectorB=xprod.Vector, Unitize=False)  # -> Vector, Length
unit_2 = UnitVector(Vector=xprod_2.Vector)
multiplication_6 = Multiplication(A=unit_2, B=Slider(0.04, range=-0.5..0.5))
extr_2 = Extrude(Base=extr, Direction=multiplication_6)

xprod_3 = CrossProduct(VectorA=line_2, VectorB=divlength_2.Tangents, Unitize=False)  # -> Vector, Length
unit_3 = UnitVector(Vector=xprod_3.Vector)
multiplication_7 = Multiplication(A=unit_3, B=Slider(0.16, range=-0.5..0.5))
extr_3 = Extrude(Base=line_2, Direction=multiplication_7)
xprod_4 = CrossProduct(VectorA=line_2, VectorB=xprod_3.Vector, Unitize=False)  # -> Vector, Length
unit_4 = UnitVector(Vector=xprod_4.Vector)
multiplication_8 = Multiplication(A=unit_4, B=Slider(0.04, range=-0.5..0.5))
extr_4 = Extrude(Base=extr_3, Direction=multiplication_8)

Y_3 = UnitY(Factor=1)
end = EndPoints(Curve=costole_1)  # -> Start, End
pl = PlaneNormal(Origin=end.Start, ZAxis=Y_3)
lng = ListLength(List=pl)
series = Series(Start=0, Step=1, Count=lng)
piani = ListItem(List=pl, Index=expr("i+1", series), Wrap=False)
costole = ListItem(List=costole_1, Index=series, Wrap=False)
project = Project(Geometry=costole, Plane=piani)  # -> Geometry, Transform
Y_4 = UnitY(Factor="-0.05")
extr_5 = Extrude(Base=project.Geometry, Direction=Y_4)

Y_5 = UnitY(Factor=1)
end_2 = EndPoints(Curve=costole_1_2)  # -> Start, End
pl_2 = PlaneNormal(Origin=end_2.Start, ZAxis=Y_5)
lng_2 = ListLength(List=pl_2)
series_2 = Series(Start=0, Step=1, Count=lng_2)
costole_2 = ListItem(List=costole_1_2, Index=series_2, Wrap=False)
piani_2 = ListItem(List=pl_2, Index=expr("i+1", series_2), Wrap=False)
project_2 = Project(Geometry=costole_2, Plane=piani_2)  # -> Geometry, Transform
Y_6 = UnitY(Factor="-0.05")
extr_6 = Extrude(Base=project_2.Geometry, Direction=Y_6)

multiplication_9 = Multiplication(A=unit, B=0.04)
multiplication_10 = Multiplication(A=unit_3, B=0.04)

Y_7 = UnitY(Factor="0.05")
extr_7 = Extrude(Base=costole_1, Direction=Y_7)

move_7 = Move(Geometry=extr_2, Motion=multiplication_9)  # -> Geometry, Transform

Y_8 = UnitY(Factor="0.05")
extr_8 = Extrude(Base=costole_1_2, Direction=Y_8)

move_8 = Move(Geometry=extr_4, Motion=multiplication_10)  # -> Geometry, Transform
viewer = ParamViewer(move_7.Geometry)
preview_3 = CustomPreview(Geometry=move_7.Geometry, Shader=ColourSwatch(SwatchColor=RGB(0, 5, 107)))
preview_4 = CustomPreview(Geometry=extr_7, Shader=ColourSwatch(SwatchColor=RGB(0, 5, 107)))
preview_5 = CustomPreview(Geometry=extr_5, Shader=ColourSwatch(SwatchColor=RGB(158, 0, 0)))
preview_6 = CustomPreview(Geometry=extr_8, Shader=ColourSwatch(SwatchColor=RGB(0, 5, 107)))
preview_7 = CustomPreview(Geometry=move_8.Geometry, Shader=ColourSwatch(SwatchColor=RGB(0, 5, 107)))
preview_8 = CustomPreview(Geometry=extr_6, Shader=ColourSwatch(SwatchColor=RGB(158, 0, 0)))
geo = Geometry(move_7.Geometry)

geo_2 = Geometry(flatten(extr_8))
xy_5 = XYPlane(Origin=Point(0, 0, 0))
xz_3 = XZPlane(Origin=Point(0, 0, 0))
orient = Orient(Geometry=geo_2, Source=xz_3, Target=xy_5)  # -> Geometry, Transform
lng_3 = ListLength(List=orient.Geometry)
series_3 = Series(Start=0, Step=1, Count=expr("c-1", lng_3))
series_4 = Series(Start="0", Step=expr("n+3.8", "0"), Count=expr("c-1", lng_3))
item_7 = ListItem(List=orient.Geometry, Index=series_3, Wrap=False)
Y_9 = UnitY(Factor=series_4)
slider = Slider(35, range=0..35)
move_9 = Move(Geometry=item_7, Motion=Y_9)  # -> Geometry, Transform
X_3 = UnitX(Factor=slider)
move_10 = Move(Geometry=move_9.Geometry, Motion=X_3)  # -> Geometry, Transform

geo_3 = Geometry(move_8.Geometry)

geo_4 = Geometry(flatten(extr_7))
xy_6 = XYPlane(Origin=Point(0, 0, 0))
xz_4 = XZPlane(Origin=Point(0, 0, 0))
orient_2 = Orient(Geometry=geo_4, Source=xz_4, Target=xy_6)  # -> Geometry, Transform
lng_4 = ListLength(List=orient_2.Geometry)
series_5 = Series(Start=0, Step=1, Count=expr("c-1", lng_4))
series_6 = Series(Start="0", Step=expr("n+3.8", "0"), Count=expr("c-1", lng_4))
item_8 = ListItem(List=orient_2.Geometry, Index=series_5, Wrap=False)
Y_10 = UnitY(Factor=series_6)
slider_2 = Slider(19, range=0..30)
move_11 = Move(Geometry=item_8, Motion=Y_10)  # -> Geometry, Transform
X_4 = UnitX(Factor=slider_2)
move_12 = Move(Geometry=move_11.Geometry, Motion=X_4)  # -> Geometry, Transform

project_3 = Project(Geometry=move_10.Geometry, Plane=xy)  # -> Geometry, Transform
project_4 = Project(Geometry=move_12.Geometry, Plane=xy_3)  # -> Geometry, Transform
explode = BrepComponents(Brep=project_3.Geometry)  # -> Faces, Edges, Vertices
explode_2 = BrepComponents(Brep=project_4.Geometry)  # -> Faces, Edges, Vertices
item_9 = ListItem(List=explode.Edges, Index=panel_6, Wrap=False)
item_10 = ListItem(List=explode_2.Edges, Index=panel_7, Wrap=False)
crv_7 = Curve(item_9)
crv_8 = Curve(item_10)

xy_7 = XYPlane(Origin=Point(0, 0, 0))
xz_5 = XZPlane(Origin=Point(0, 0, 0))
orient_3 = Orient(Geometry=geo, Source=xz_5, Target=xy_7)  # -> Geometry, Transform
X_5 = UnitX(Factor=slider_2)

viewer_2 = ParamViewer(orient_3.Geometry)
flip = FlipMatrix(Data=orient_3.Geometry)

lng_5 = ListLength(List=viewer_2)
series_7 = Series(Start=0, Step=1, Count=expr("c-1", lng_5))
series_8 = Series(Start="0", Step=expr("n+3.8", "0"), Count=expr("c-1", lng_5))
item_11 = ListItem(List=flip, Index=series_7, Wrap=False)
Y_11 = UnitY(Factor=series_8)
move_13 = Move(Geometry=item_11, Motion=Y_11)  # -> Geometry, Transform
move_14 = Move(Geometry=move_13.Geometry, Motion=X_5)  # -> Geometry, Transform

project_5 = Project(Geometry=move_14.Geometry, Plane=xy_2)  # -> Geometry, Transform
explode_3 = BrepComponents(Brep=project_5.Geometry)  # -> Faces, Edges, Vertices
item_12 = ListItem(List=explode_3.Edges, Index=panel_5, Wrap=False)
crv_9 = Curve(item_12)
divide_3 = DivideCurve(Curve=crv_9, Count=2, Kinks=False)  # -> Points, Tangents, Parameters
item_13 = ListItem(List=divide_3.Points, Index=1, Wrap=False)
orient_4 = OrientDirection(Geometry=crv_4, PointA=pt_10, DirectionA=Vector(0, 0, 1), PointB=item_13, DirectionB=Vector(0, 0, 1))  # -> Geometry, Transform

xy_8 = XYPlane(Origin=Point(0, 0, 0))
xz_6 = XZPlane(Origin=Point(0, 0, 0))
orient_5 = Orient(Geometry=geo_3, Source=xz_6, Target=xy_8)  # -> Geometry, Transform
X_6 = UnitX(Factor=slider)

viewer_3 = ParamViewer(orient_5.Geometry)
flip_2 = FlipMatrix(Data=orient_5.Geometry)

lng_6 = ListLength(List=viewer_3)
series_9 = Series(Start=0, Step=1, Count=expr("c-1", lng_6))
series_10 = Series(Start="0", Step=expr("n+3.8", "0"), Count=expr("c-1", lng_6))
item_14 = ListItem(List=flip_2, Index=series_9, Wrap=False)
Y_12 = UnitY(Factor=series_10)
move_15 = Move(Geometry=item_14, Motion=Y_12)  # -> Geometry, Transform
move_16 = Move(Geometry=move_15.Geometry, Motion=X_6)  # -> Geometry, Transform

project_6 = Project(Geometry=move_16.Geometry, Plane=xy_4)  # -> Geometry, Transform
explode_4 = BrepComponents(Brep=project_6.Geometry)  # -> Faces, Edges, Vertices
item_15 = ListItem(List=explode_4.Edges, Index=panel_8, Wrap=False)
crv_10 = Curve(item_15)

proiezioni = Curve([crv_9, crv_8, crv_10, crv_7])
costole_3 = Geometry([extr_6, extr_8, extr_5, extr_7])
listelli = Geometry(move_8.Geometry)
